# Grasshopper definition MeshSerializer.gh (Grasshopper 1.0.7)
# plug-ins: Swiftlet

mesh = Mesh(<mesh referenced from the Rhino model>)
mjoin = MeshJoin(Meshes=mesh)
tri = Triangulate(Mesh=mjoin)  # -> Mesh, Count
demesh = DeconstructMesh(Mesh=tri.Mesh)  # -> Vertices, Faces, Colours, Normals
python = GhPythonScript(vertices=demesh.Vertices, faces=demesh.Faces)  # -> j; inputs vertices: list of Point3d, faces: list
# ---------- python: Python ----------
__author__ = "pigac"
__version__ = "2021.11.06"

import rhinoscriptsyntax as rs
import json

verts = []
fcs = []

for v in vertices:
    verts.append([v[0], v[1], v[2]])
    
for f in faces:
    index_array = f.replace("Q(", "").replace(")", "").replace("T(", "").split(",")
    buffer = []
    for strNum in index_array:
        buffer.append(int(strNum))
    buffer.reverse()
    fcs.extend(buffer)

obj = {
"verts" : verts,
"faces" : fcs
}

j = json.dumps(obj, indent=4)
# ---------- end python ----------
python_2 = GhPythonScript(model=python)  # -> payload
# ---------- python_2: Python ----------
import json

m = json.loads(model)

p = {
"save_location" : "D:\\mesh.json",
"signature_location" : "D:\\signature.txt",
"mesh" : m
}

payload = json.dumps(p)
# ---------- end python_2 ----------
ctb = CreateTextBody(Content=python_2)
post = POSTRequest(URL="http://localhost:8000/upload-model", Body=ctb)  # -> Status, Content, Response
